# Dynamo graph ScanXMLtoRevit.dyn (Dynamo 3.2.1.5366)

script_python = Filename(".\Scan2XML.py")
file_from_path = FileObject(path=script_python)
readText = FileSystem.ReadText(file=file_from_path)
xml_do_scan = Filename("C:\Users\PunkRoque\Documents\EOX\ap_305_-_3\structure.xml")
levels = Levels("1o PAV - TÉRREO")
wall_types = WallTypes("Genérico - 14cm Alvenaria")
porta_types = FamilyTypes("Porta paramétrica - 1 folha semioca:EDITÁVEL")
janela_types = FamilyTypes("Janela paramétrica - vidro fixo:EDITÁVEL")
porta_types_2 = FamilyTypes("Abertura paramétrica - Porta:Abertura paramétrica - Porta")
python_script_from_string = PythonStringNode(script=readText, IN[0]=xml_do_scan, IN[1]=levels, IN[2]=wall_types, IN[3]=porta_types, IN[4]=janela_types, IN[5]=porta_types_2)  # CPython3
